# Dynamo graph PipeCreate.dyn (Dynamo 2.10.1.3976)

boolean = BoolSelector(false)  # frozen
file_path = Filename("..\PipeCreate.py")
python_script = Python(IN[0]=boolean, IN[1]=file_path)  # IronPython2
# ---------- python_script.python (5 lines) ----------
re  = open(r"C:\Users\95053\Desktop\Python\RevitAPI-master\RevitAPI\PipeCreate.py", "r")

interpret = re.read()

OUT =  interpret
# ----------------------------------------
python_script_from_string = PythonStringNode(script=python_script)  # IronPython2; unwired: IN[0]

# group: List Flatten
code_block = CodeBlock { lst = [[1,2],[22,55],[111111,2,3,45,6,7,8]]; }
code_block_2 = CodeBlock(a=code_block) { a; }
code_block_3 = CodeBlock(x=code_block_2) { List.Flatten(x); }
flatten_by_import_dscorenodes = Python(IN[0]=code_block)  # "Flatten by import DSCoreNodes class"; IronPython2
# ---------- flatten_by_import_dscorenodes.python (46 lines) ----------
"""Copyright by: vudinhduybm@gmail.com"""
import clr 
import System
import math 
from System.Collections.Generic import *

clr.AddReference("ProtoGeometry")
from Autodesk.DesignScript.Geometry import *

clr.AddReference('RevitAPI')
import Autodesk
from Autodesk.Revit.DB import *

clr.AddReference('RevitAPIUI')
from Autodesk.Revit.UI import*
from  Autodesk.Revit.UI.Selection import*

clr.AddReference("RevitNodes")
import Revit
clr.ImportExtensions(Revit.Elements)
clr.ImportExtensions(Revit.GeometryConversion)

clr.AddReference("RevitServices")
import RevitServices
from RevitServices.Persistence import DocumentManager
from RevitServices.Transactions import TransactionManager

clr.AddReference("DSCoreNodes")
from DSCore.List import Flatten

doc = DocumentManager.Instance.CurrentDBDocument
view = doc.ActiveView
uidoc = DocumentManager.Instance.CurrentUIApplication.ActiveUIDocument

#Preparing input from dynamo to revit
element = UnwrapElement(IN[0])

#Do some action in a Transaction
TransactionManager.Instance.EnsureInTransaction(doc)
"""Now, You Can Code """



TransactionManager.Instance.TransactionTaskDone()

OUT = Flatten(IN[0])
# ----------------------------------------
flatten_by_hasattr_and = Python(IN[0]=code_block)  # "Flatten by hasattr and isinstance function"; IronPython2
# ---------- flatten_by_hasattr_and.python (51 lines) ----------
"""Copyright by: vudinhduybm@gmail.com"""
import clr 
import System
import math 
from System.Collections.Generic import *

clr.AddReference("ProtoGeometry")
from Autodesk.DesignScript.Geometry import *

clr.AddReference('RevitAPI')
import Autodesk
from Autodesk.Revit.DB import *

clr.AddReference('RevitAPIUI')
from Autodesk.Revit.UI import*
from  Autodesk.Revit.UI.Selection import*

clr.AddReference("RevitNodes")
import Revit
clr.ImportExtensions(Revit.Elements)
clr.ImportExtensions(Revit.GeometryConversion)

clr.AddReference("RevitServices")
import RevitServices
from RevitServices.Persistence import DocumentManager
from RevitServices.Transactions import TransactionManager

doc = DocumentManager.Instance.CurrentDBDocument
view = doc.ActiveView
uidoc = DocumentManager.Instance.CurrentUIApplication.ActiveUIDocument

#Preparing input from dynamo to revit
element = UnwrapElement(IN[0])

#Do some action in a Transaction
TransactionManager.Instance.EnsureInTransaction(doc)
"""Now, You Can Code """
def flatten(x):
    result = []
    try:
    	for el in x:
        	if hasattr(el, "__iter__") and not isinstance(el, basestring):
        	    result.extend(flatten(el))
        	else:
        	    result.append(el)
    except:
    	result = x
    return result

TransactionManager.Instance.TransactionTaskDone()
OUT = flatten(IN[0])
# ----------------------------------------
flatten_by_import_collections = Python(IN[0]=code_block)  # "Flatten by import collections class"; IronPython2
# ---------- flatten_by_import_collections.python (48 lines) ----------
"""Copyright by: vudinhduybm@gmail.com"""
import clr 
import System
import math 
from System.Collections.Generic import *

clr.AddReference("ProtoGeometry")
from Autodesk.DesignScript.Geometry import *

clr.AddReference('RevitAPI')
import Autodesk
from Autodesk.Revit.DB import *

clr.AddReference('RevitAPIUI')
from Autodesk.Revit.UI import*
from  Autodesk.Revit.UI.Selection import*

clr.AddReference("RevitNodes")
import Revit
clr.ImportExtensions(Revit.Elements)
clr.ImportExtensions(Revit.GeometryConversion)

clr.AddReference("RevitServices")
import RevitServices
from RevitServices.Persistence import DocumentManager
from RevitServices.Transactions import TransactionManager

import collections

doc = DocumentManager.Instance.CurrentDBDocument
view = doc.ActiveView
uidoc = DocumentManager.Instance.CurrentUIApplication.ActiveUIDocument

#Preparing input from dynamo to revit
element = UnwrapElement(IN[0])

#Do some action in a Transaction
TransactionManager.Instance.EnsureInTransaction(doc)
"""Now, You Can Code """

def flattenList(unflattened_list):
	if isinstance(unflattened_list,collections.Iterable):
		return [sub_element for element in unflattened_list for sub_element in flattenList(element)]
	else:
		return [unflattened_list]

TransactionManager.Instance.TransactionTaskDone()
OUT = flattenList(IN[0])
# ----------------------------------------

boolean_2 = BoolSelector(true)  # frozen
python_script_2 = Python(IN[0]=boolean_2)  # IronPython2
# ---------- python_script_2.python (71 lines) ----------
import clr
import sys 
import System   
import math

clr.AddReference("ProtoGeometry")
from Autodesk.DesignScript.Geometry import *

clr.AddReference("RevitAPI") 
import Autodesk
from Autodesk.Revit.DB import* 
from Autodesk.Revit.DB.Structure import*

clr.AddReference("RevitAPIUI") 
from Autodesk.Revit.UI import*

clr.AddReference("System") 
from System.Collections.Generic import List

clr.AddReference("RevitNodes")
import Revit
clr.ImportExtensions(Revit.Elements)
clr.ImportExtensions(Revit.GeometryConversion)

clr.AddReference("RevitServices")
import RevitServices
from RevitServices.Persistence import DocumentManager
from RevitServices.Transactions import TransactionManager

clr.AddReference("System.Windows.Forms")
clr.AddReference("System.Drawing")
clr.AddReference("System.Windows.Forms.DataVisualization")

import System.Windows.Forms 
from System.Windows.Forms import *
import System.Drawing
from System.Drawing import *
"""_______________________________________________________________________________________"""
doc = DocumentManager.Instance.CurrentDBDocument
uiapp = DocumentManager.Instance.CurrentUIApplication
app = uiapp.Application
uidoc = DocumentManager.Instance.CurrentUIApplication.ActiveUIDocument



TransactionManager.Instance.EnsureInTransaction(doc)

activeView = doc.ActiveView
iRefPlane = Plane.CreateByNormalAndOrigin(activeView.ViewDirection, activeView.Origin)
sketchPlane = SketchPlane.Create(doc, iRefPlane)
doc.ActiveView.SketchPlane = sketchPlane
condition = True
points = []
desPoints = []
n = 0
msg = "Pick Points on Current Section plane, hit ESC when finished."
TaskDialog.Show("^------^", msg)
while condition:
	try:
		pt=uidoc.Selection.PickPoint()
		n += 1
		points.append(pt)
	except :
		condition = False
doc.Delete(sketchPlane.Id)	
for j in points:
	rpM = Autodesk.DesignScript.Geometry.Point.ByCoordinates(j.X*304.8, j.Y*304.8, j.Z*304.8)
	desPoints.Add(rpM)
TransactionManager.Instance.TransactionTaskDone()	

OUT = desPoints
# ----------------------------------------
code_block_4 = CodeBlock(x=python_script_2) { List.Flatten(x); }
python_script_3 = Python(IN[0]=code_block_4)  # IronPython2
# ---------- python_script_3.python (82 lines) ----------
import clr
import sys 
import System   
import math

clr.AddReference("ProtoGeometry")
from Autodesk.DesignScript.Geometry import *

clr.AddReference("RevitAPI") 
import Autodesk
from Autodesk.Revit.DB import* 
from Autodesk.Revit.DB.Structure import*

clr.AddReference("RevitAPIUI") 
from Autodesk.Revit.UI import*

clr.AddReference("System") 
from System.Collections.Generic import List

clr.AddReference("RevitNodes")
import Revit
clr.ImportExtensions(Revit.Elements)
clr.ImportExtensions(Revit.GeometryConversion)

clr.AddReference("RevitServices")
import RevitServices
from RevitServices.Persistence import DocumentManager
from RevitServices.Transactions import TransactionManager

clr.AddReference("System.Windows.Forms")
clr.AddReference("System.Drawing")
clr.AddReference("System.Windows.Forms.DataVisualization")

import System.Windows.Forms 
from System.Windows.Forms import *
import System.Drawing
from System.Drawing import *

#Current doc/app/ui
doc = DocumentManager.Instance.CurrentDBDocument
uiapp = DocumentManager.Instance.CurrentUIApplication
app = uiapp.Application
uidoc = DocumentManager.Instance.CurrentUIApplication.ActiveUIDocument
view = doc.ActiveView

#Preparing input from dynamo to revit
points = UnwrapElement(IN[0])
circles = []
modelCurves = []
circle_refs = []
TransactionManager.Instance.EnsureInTransaction(doc)
iRefPlane = Plane.CreateByNormalAndOrigin(view.ViewDirection, view.Origin)
sketchPlane = SketchPlane.Create(doc, iRefPlane)
doc.ActiveView.SketchPlane = sketchPlane
red_color = Autodesk.Revit.DB.Color(255, 0, 0)


fill_pattern_elements = list(FilteredElementCollector(doc).OfClass(FillPatternElement))
hatch_pattern_names = [element.Name for element in fill_pattern_elements if element.GetFillPattern().Target == FillPatternTarget.Model]
fill_pattern = fill_pattern_elements[0]

# Create circles for each center point
TransactionManager.Instance.EnsureInTransaction(doc)

for point in points:

    XYZ_point = XYZ(point.X/304.8, point.Y/304.8, point.Z/304.8)
    radius = 1/304.8*50  # You can set your desired radius
    circle = Arc.Create(XYZ_point, radius, 0.0, 2 * 3.142,  XYZ.BasisX, XYZ.BasisY)
    model_curve = doc.Create.NewModelCurve(circle, sketchPlane)
    #filled_regionArray = FilledRegion.Create(doc, fill_pattern.Id, doc.ActiveView.Id, model_curve)
    circles.append(circle.ToProtoType())
    circle_refs.append(model_curve.GeometryCurve.Reference)
    modelCurves.append(model_curve)
    filled_regionArray = FilledRegion.Create(doc, fill_pattern.Id, view.Id, [circle.Reference])
# End the transaction


TransactionManager.Instance.TransactionTaskDone()

# Output: List of created circles
OUT = fill_pattern
# ----------------------------------------
python_script_4 = Python(IN[0]=code_block_4)  # IronPython2
# ---------- python_script_4.python (78 lines) ----------
import clr
import sys 
import System   
import math

clr.AddReference("ProtoGeometry")
from Autodesk.DesignScript.Geometry import *

clr.AddReference("RevitAPI") 
import Autodesk
from Autodesk.Revit.DB import* 
from Autodesk.Revit.DB.Structure import*

clr.AddReference("RevitAPIUI") 
from Autodesk.Revit.UI import*

clr.AddReference("System") 
from System.Collections.Generic import List

clr.AddReference("RevitNodes")
import Revit
clr.ImportExtensions(Revit.Elements)
clr.ImportExtensions(Revit.GeometryConversion)

clr.AddReference("RevitServices")
import RevitServices
from RevitServices.Persistence import DocumentManager
from RevitServices.Transactions import TransactionManager

clr.AddReference("System.Windows.Forms")
clr.AddReference("System.Drawing")
clr.AddReference("System.Windows.Forms.DataVisualization")

import System.Windows.Forms 
from System.Windows.Forms import *
import System.Drawing
from System.Drawing import *

#Current doc/app/ui
doc = DocumentManager.Instance.CurrentDBDocument
uiapp = DocumentManager.Instance.CurrentUIApplication
app = uiapp.Application
uidoc = DocumentManager.Instance.CurrentUIApplication.ActiveUIDocument
view = doc.ActiveView

#Preparing input from dynamo to revit
points = UnwrapElement(IN[0])
circles = []
modelCurves = []
TransactionManager.Instance.EnsureInTransaction(doc)
iRefPlane = Plane.CreateByNormalAndOrigin(view.ViewDirection, view.Origin)
sketchPlane = SketchPlane.Create(doc, iRefPlane)
doc.ActiveView.SketchPlane = sketchPlane
red_color = Autodesk.Revit.DB.Color(255, 0, 0)


fill_pattern_elements = list(FilteredElementCollector(doc).OfClass(FillPatternElement))
hatch_pattern_names = [element.Name for element in fill_pattern_elements if element.GetFillPattern().Target == FillPatternTarget.Model]
fill_pattern = fill_pattern_elements[0]

# Create circles for each center point
TransactionManager.Instance.EnsureInTransaction(doc)

for point in points:

    XYZ_point = XYZ(point.X/304.8, point.Y/304.8, point.Z/304.8)
    radius = 1/304.8*50  # You can set your desired radius
    circle = Arc.Create(XYZ_point, radius, 0.0, 2 * 3.14,  XYZ.BasisX, XYZ.BasisY)
    model_curve = doc.Create.NewModelCurve(circle, sketchPlane)
    #filled_regionArray = FilledRegion.Create(doc, fill_pattern.Id, doc.ActiveView.Id, model_curve)
    circles.append(circle.ToProtoType())
    modelCurves.append(model_curve)
# End the transaction

TransactionManager.Instance.TransactionTaskDone()

# Output: List of created circles
OUT = fill_pattern.Id
# ----------------------------------------
boolean_3 = BoolSelector(false)
file_path_2 = Filename("..\MarkupPickedPoints.py")
python_script_5 = Python(IN[0]=boolean_3, IN[1]=file_path_2)  # IronPython2
# ---------- python_script_5.python (5 lines) ----------
re  = open(r"C:\Users\95053\Desktop\Python\RevitAPI-master\RevitAPI\MarkupPickedPoints.py", "r")

interpret = re.read()

OUT =  interpret
# ----------------------------------------
python_script_from_string_2 = PythonStringNode(script=python_script_5)  # IronPython2; unwired: IN[0]
pickObjects = Python()  # IronPython2; frozen; unwired: IN[0]
# ---------- pickObjects.python (36 lines) ----------
"""Copyright by: vudinhduybm@gmail.com"""
import clr 
import System
import math 
from System.Collections.Generic import *

clr.AddReference("ProtoGeometry")
from Autodesk.DesignScript.Geometry import *

clr.AddReference('RevitAPI')
import Autodesk
from Autodesk.Revit.DB import *

clr.AddReference('RevitAPIUI')
from Autodesk.Revit.UI import*
from Autodesk.Revit.UI.Selection import*
from Autodesk.Revit.UI.Selection import ObjectType
clr.AddReference("RevitNodes")
import Revit
clr.ImportExtensions(Revit.Elements)
clr.ImportExtensions(Revit.GeometryConversion)

clr.AddReference("RevitServices")
import RevitServices
from RevitServices.Persistence import DocumentManager
from RevitServices.Transactions import TransactionManager

doc = DocumentManager.Instance.CurrentDBDocument
view = doc.ActiveView
uidoc = DocumentManager.Instance.CurrentUIApplication.ActiveUIDocument

def pickObjects():
    refs = uidoc.Selection.PickObjects(ObjectType.Element)
    return  [doc.GetElement(i.ElementId) for i in refs], [ref for ref in refs]

OUT = pickObjects()
# ----------------------------------------
boolean_4 = BoolSelector(true)  # frozen
file_path_3 = Filename("..\CheckElementOrigin.py")
python_script_6 = Python(IN[0]=boolean_4, IN[1]=file_path_3)  # IronPython2
# ---------- python_script_6.python (5 lines) ----------
re  = open(r"C:\Users\95053\Desktop\Python\RevitAPI-master\RevitAPI\CheckElementOrigin.py", "r")

interpret = re.read()

OUT =  interpret
# ----------------------------------------
python_script_from_string_3 = PythonStringNode(script=python_script_6)  # IronPython2; unwired: IN[0]
boolean_5 = BoolSelector(false)  # frozen
python_script_7 = Python(IN[0]=boolean_5)  # IronPython2; frozen
# ---------- python_script_7.python (51 lines) ----------
"""Copyright by: vudinhduybm@gmail.com"""
import clr 
import sys 
import System   
clr.AddReference("ProtoGeometry")
from Autodesk.DesignScript.Geometry import *

clr.AddReference("RevitAPI") 
from Autodesk.Revit.DB import*
from Autodesk.Revit.DB.Structure import*

clr.AddReference("RevitAPIUI") 
from Autodesk.Revit.UI import*

clr.AddReference("System") 
from System.Collections.Generic import List

clr.AddReference("RevitNodes")
import Revit
clr.ImportExtensions(Revit.Elements)
clr.ImportExtensions(Revit.GeometryConversion)

clr.AddReference("RevitServices")
import RevitServices
from RevitServices.Persistence import DocumentManager
from RevitServices.Transactions import TransactionManager

#Current doc/app/ui
doc = DocumentManager.Instance.CurrentDBDocument
uiapp = DocumentManager.Instance.CurrentUIApplication
app = uiapp.Application
uidoc = DocumentManager.Instance.CurrentUIApplication.ActiveUIDocument
view = doc.ActiveView

existedTextNoteTypes = FilteredElementCollector(doc).OfClass(TextNoteType).ToElements()
desTextNoteType = existedTextNoteTypes[0]
transaction = Transaction(doc, "Change Text Size")
transaction.Start()
try:
    desTextNoteType.get_Parameter(BuiltInParameter.TEXT_SIZE).Set(100 / 304.8)  
    desTextNoteType.get_Parameter(BuiltInParameter.LINE_COLOR).Set(255, 0, 0)  
    transaction.Commit()
except Exception as ex:
    transaction.RollBack()

existedTextNoteTypesName = []
for i in existedTextNoteTypes:
	i.get_Parameter(BuiltInParameter.SYMBOL_NAME_PARAM).AsValueString()
	existedTextNoteTypesName.append(i)
	
OUT = existedTextNoteTypesName
# ----------------------------------------
python_script_8 = Python(IN[0]=boolean_5)  # IronPython2
# ---------- python_script_8.python (49 lines) ----------
"""Copyright by: vudinhduybm@gmail.com"""
import clr 
import sys 
import System   
clr.AddReference("ProtoGeometry")
from Autodesk.DesignScript.Geometry import *

clr.AddReference("RevitAPI") 
from Autodesk.Revit.DB import*
from Autodesk.Revit.DB.Structure import*

clr.AddReference("RevitAPIUI") 
from Autodesk.Revit.UI import*

clr.AddReference("System") 
from System.Collections.Generic import List

clr.AddReference("RevitNodes")
import Revit
clr.ImportExtensions(Revit.Elements)
clr.ImportExtensions(Revit.GeometryConversion)

clr.AddReference("RevitServices")
import RevitServices
from RevitServices.Persistence import DocumentManager
from RevitServices.Transactions import TransactionManager

#Current doc/app/ui
doc = DocumentManager.Instance.CurrentDBDocument
uiapp = DocumentManager.Instance.CurrentUIApplication
app = uiapp.Application
uidoc = DocumentManager.Instance.CurrentUIApplication.ActiveUIDocument
view = doc.ActiveView

existedTextNoteTypes = FilteredElementCollector(doc).OfClass(TextNoteType).ToElements()
desTextNoteType = existedTextNoteTypes[0]
transaction = Transaction(doc, "Change Text Size")
transaction.Start()
try:
    desTextNoteType.get_Parameter(BuiltInParameter.TEXT_SIZE).Set(200 / 304.8)  
    desTextNoteType.get_Parameter(BuiltInParameter.LINE_COLOR).Set(255)  
    transaction.Commit()
except Exception as ex:
    transaction.RollBack()

existedTextNoteTypesName = []

	
OUT = desTextNoteType
# ----------------------------------------
